# Grasshopper definition Differential Growth Simulator_Test 1.gh (Grasshopper 1.0.7)
# plug-ins: Weaverbird, Kangaroo Components, Kangaroo2 Components, Anemone, Hops

growth_radius = Slider(3.1, range=0..10)
cell_radius = Slider(10, range=10..20)
pt = ConstructPoint(XCoordinate=0, YCoordinate=0, ZCoordinate=0)
get_integer = GetInteger(cell_radius, AtLeast=1, AtMost=1, Maximum=2147483647, Minimum=-2147483648, Prompt="Cell Radius")
get_number = GetNumber(growth_radius, AtLeast=1, AtMost=1, Maximum=1.797693135e+308, Minimum=-1.797693135e+308, Prompt="Growth Radius")
get_number_2 = GetNumber(Slider(0.6, range=0..1), AtLeast=1, AtMost=1, Maximum=1, Minimum=0, Prompt="Choose a Color")
get_point = GetPoint(pt, AtLeast=1, AtMost=1, Prompt="Enter and Point", Realtime=True)
xz_plane = XZPlane(Origin=Point(0, 0, 0))
msphere = MeshSphere(Base=get_point, Radius=get_integer, UCount=10, VCount=20)
rotate = Rotate(Geometry=msphere, Angle=Slider(0.1, range=0..0.1), Plane=xz_plane)  # -> Geometry, Transform
number_slider = Slider(16, range=0..100)
number_slider_2 = Slider(0, range=0..100)
triangulate = Triangulate(Mesh=rotate.Geometry)  # -> Mesh, Count
loop_start = LoopStart(Repeat=Slider(10, range=0..10), Trigger=Button(), Data=triangulate.Mesh)  # -> port, Counter, Data
modulus = Modulus(A=loop_start.Counter, B=Slider(10, range=0..10))
equality = Equality(FirstNumber=modulus, SecondNumber=Slider(0, range=0..100))  # -> Equality, Inequality
mesh = Mesh(loop_start.Data)
dispatch = Dispatch(List=mesh, DispatchPattern=equality.Equality)  # -> ListA, ListB
weaverbird_s_catmull_clark_subdivision = WeaverbirdsCatmullClarkSubdivision(MeshCurves=dispatch.ListA, Level=1, SmoothNakedEdges=1)
clean_tree = CleanTree(
    RemoveNulls=True,
    RemoveInvalid=True,
    RemoveEmpty=False,
    Tree=flatten([weaverbird_s_catmull_clark_subdivision, dispatch.ListB]))
deconstruct_mesh = DeconstructMesh(Mesh=clean_tree)  # -> Vertices, Faces, Colours, Normals
mesh_edges = MeshEdges(Mesh=clean_tree)  # -> NakedEdges, InteriorEdges, NonManifoldEdges
removeduplicatepts = RemoveDuplicatePts(Points=deconstruct_mesh.Vertices, Tolerance=0.01)
show = Show(G=clean_tree)
length_line = LengthLine(Line=[mesh_edges.InteriorEdges, mesh_edges.NakedEdges], Strength=10)
spherecollide = SphereCollide(Points=removeduplicatepts, Radius=get_number, Strength=1)
zombiesolver = ZombieSolver(
    GoalObjects=[spherecollide, length_line, show],
    Threshold=1e-10,
    Tolerance=0.0001,
    MaxIterations=Slider(50, range=0..100))  # -> I, V, O
list_item = ListItem(List=zombiesolver.O, Index=0, Wrap=True)
loop_end = LoopEnd(port=loop_start.port, Exit=False, Data=list_item, TimeOutVal=0, pausedState=False, state="Constant output")
weaverbird_s_catmull_clark_subdivision_2 = WeaverbirdsCatmullClarkSubdivision(MeshCurves=loop_end, Level=1, SmoothNakedEdges=1)
hsv = ColourHSV(Alpha=1, Hue=get_number_2, Saturation=1, Value=1)
wbcatmullclark = WeaverbirdsCatmullClarkSubdivision(MeshCurves=weaverbird_s_catmull_clark_subdivision_2, Level=1, SmoothNakedEdges=1)
subd = SubD(wbcatmullclark)
preview = CustomPreview(Geometry=wbcatmullclark, Material=hsv)
hops = Hops(
    GetInteger=10,
    GetNumber=3.1,
    CacheResultsInMemory=True,
    CacheSolveResults=True,
    RemoteDefinitionLocation="C:\Users\Irene\Desktop\MaCAD\MaCAD\M2 - Building Information Modelling and Smart Construction\S3 - Digital Tools for Cloud-based Data Management\02 - Assignments\Session 01\01 Working Files\Diferential Growth\_Irene\Differential Growth Simulator_Test 1.gh",
    RemoteSolveVersion=(0, 1, 0),
    ShowInput_Enabled=False,
    ShowInput_Path=False,
    SynchronousSolve=True)
context_bake = ContextBake(Geometry=subd)
